# Grasshopper definition RoadDetailBuilder.gh (Grasshopper 1.0.8)

number_slider = Slider(0.1, range=0.1..3)
py3 = Python3Script(run=Toggle(False), bake=Toggle(False), lane_width=Slider(3, range=2.5..4), line_width=Slider(0.1, range=0.1..0.3))  # -> out, preview; inputs lane_width: Double, line_width: tree of Double; unedited script template
